# Grasshopper definition Grasshopper Dorkshop Tutorial.gh (Grasshopper 1.0.7)

brep = Brep()
crv = Curve()
brep_2 = Brep()
Z = UnitZ(Factor=Slider(18, range=0..100))
debrep = DeconstructBrep(Brep=brep)  # -> Faces, Edges, Vertices

# ---- group: Attains bottom face
debrep_2 = DeconstructBrep(Brep=brep_2)  # -> Faces, Edges, Vertices
area = Area(Geometry=debrep_2.Faces)  # -> Area, Centroid
pdecon = Deconstruct(Point=area.Centroid)  # -> XComponent, YComponent, ZComponent
sort = SortList(Keys=pdecon.ZComponent, ValuesA=debrep_2.Faces)  # -> Keys, ValuesA
num = Number(0)
item = ListItem(List=sort.ValuesA, Index=num, Wrap=True)

# ----
extr = Extrude(Base=crv, Direction=Z)
area_2 = Area(Geometry=debrep.Faces)  # -> Area, Centroid
cap = CapHoles(Brep=extr)
evalsrf = EvaluateSurface(Surface=debrep.Faces, Point=area_2.Centroid)  # -> Point, Normal, UDirection, VDirection, Frame
amp = Amplitude(Vector=evalsrf.Normal, Amplitude=Slider(5, range=0..10))
circle = CircleCNR(Center=area_2.Centroid, Normal=evalsrf.Normal, Radius=Slider(1.25, range=0..2))
sphere_radius = Slider(0.69, range=0..1)
of_divisions = Slider(38, range=0..50)

# ---- group: Creates curve out of face, divides by specified number
edges = BrepEdges(Brep=item)  # -> Naked, Interior, NonManifold
join = JoinCurves(Curves=edges.Naked, Preserve=False)
divide = DivideCurve(Curve=join, Count=of_divisions, Kinks=False)  # -> Points, Tangents, Parameters

# ----
dist_between_layers = Slider(0.8, range=0..3)
extr_2 = Extrude(Base=circle, Direction=amp)
cap_2 = CapHoles(Brep=extr_2)
merge = Merge(Data1=flatten(brep), Data2=flatten(cap_2))

# ---- group: CREATES SPHERES AND COPIES IN Z DIRECTION
sph = Sphere(Base=divide.Points, Radius=sphere_radius)  # -> graft(Sphere)
series = Series(Start=0, Step=dist_between_layers, Count=10)
Z_2 = UnitZ(Factor=series)
move = Move(Geometry=simplify(sph), Motion=Z_2)  # -> Geometry, Transform

# ----
group = Group(Objects=merge)
bake_me = Brep(move.Geometry)
